# Dynamo graph Fix Element Pipe Duplicate.dyn (Dynamo 2.1.0.7500)

categories = Categories("OST_PipeCurves")
all_elements_of_category = ElementsOfCategory(Category=categories)
location = Custom[Element.Location+](element=all_elements_of_category)  # Returns the location of an element as point, curve or curve loop, along with some booleans to help filtering the results. Unlike the OOTB Element.GetLocation node, it also retunrs sketch lines of sketch-based elements like floor slabs as well as the element's rotation property.
code_block = CodeBlock { 0; 1; }
getItemAtIndex = List.GetItemAtIndex(list=location.curveEndpoints@L2, index=code_block.out0)
getItemAtIndex_2 = List.GetItemAtIndex(list=location.curveEndpoints@L2, index=code_block.out1)
midPoint = Geometry.Point.MidPoint(p1=getItemAtIndex, p2=getItemAtIndex_2)
python_scripts = Python(IN[0]=midPoint)
# ---------- python_scripts.python (41 lines) ----------
import clr
clr.AddReference('ProtoGeometry')
from Autodesk.DesignScript.Geometry import *

# Import DocumentManager and TransactionManager
clr.AddReference("RevitServices")
import RevitServices
from RevitServices.Persistence import DocumentManager
from RevitServices.Transactions import TransactionManager

# Import RevitAPI
clr.AddReference("RevitAPI")
import Autodesk
from Autodesk.Revit.DB import *

doc = DocumentManager.Instance.CurrentDBDocument
uiapp = DocumentManager.Instance.CurrentUIApplication
app = uiapp.Application

from System.Collections.Generic import *

# Import ToDSType(bool) extension method
clr.AddReference("RevitNodes")
import Revit
clr.ImportExtensions(Revit.Elements)

#The inputs to this node will be stored as a list in the IN variable.
dataEnteringNode = IN
mylist = IN[0]

i, seen, result = mylist, set(), []
for _index, item in enumerate(i):
    if item not in seen:
		# First time seeing the element
        seen.add(item)
    else:
		 # Already seen, add the index to the result
        result.append(_index)     

#Assign your output to the OUT variable
OUT = result
# ----------------------------------------
getItemAtIndex_3 = List.GetItemAtIndex(list=all_elements_of_category, index=python_scripts)
delete = Python(IN[0]=getItemAtIndex_3)  # "Element.Delete"; frozen
# ---------- delete.python (46 lines) ----------
import clr
clr.AddReference('ProtoGeometry')
from Autodesk.DesignScript.Geometry import *

# Import DocumentManager and TransactionManager
clr.AddReference("RevitServices")
import RevitServices
from RevitServices.Persistence import DocumentManager
from RevitServices.Transactions import TransactionManager

# Import RevitAPI
clr.AddReference("RevitAPI")
import Autodesk
from Autodesk.Revit.DB import *

doc = DocumentManager.Instance.CurrentDBDocument
uiapp = DocumentManager.Instance.CurrentUIApplication
app = uiapp.Application

from System.Collections.Generic import *

#The inputs to this node will be stored as a list in the IN variable.
dataEnteringNode = IN

elements = IN[0]

def toRvtId(_id):
	if isinstance(_id, int) or isinstance(_id, str):
		id = ElementId(int(_id))
		return id
	elif isinstance(_id, ElementId):
		return _id

#"Start" the transaction
TransactionManager.Instance.EnsureInTransaction(doc)

results = []
for i in elements:
	doc.Delete(toRvtId(i.Id))
	results.append("Family ID" + i.Id.ToString() + " was deleted.")

# "End" the transaction
TransactionManager.Instance.TransactionTaskDone()

#Assign your output to the OUT variable
OUT = results
# ----------------------------------------
location_2 = FamilyInstance.Location(familyInstance=all_elements_of_category)  # frozen
directory_path = Directory("No file selected.")
code_block_2 = CodeBlock { "Sheet1"; }
code_block_3 = CodeBlock { 0; }
flatten = List.Flatten(list=getItemAtIndex_3)
id = Element.Id(element=getItemAtIndex_3)
transpose = List.Transpose(lists=id)
list_create = List.Create(item0=flatten, item1=transpose)
boolean = BoolSelector(false)
exportExcel = Data.ExportExcel(filePath=directory_path, sheetName=code_block_2, startRow=code_block_3, startCol=code_block_3, data=list_create, overWrite=boolean)
delete_2 = Orchid.RevitProject.Elements.Element.Delete()  # unwired: element
